# Grasshopper definition fractal_tree_00.gh (Grasshopper 1.0.4)

range = Range(Domain=Slider(10000, range=0..10000), Steps=10)
length_randomness = Slider(83, range=0..100)
angle_randomness = Slider(23, range=0..100)
length_randomness_2 = Slider(0, range=0..100)
angle_randomness_2 = Slider(0, range=0..100)
length_change = Slider(0.7, range=-0.1..0.9)
starting_length = Slider(241, range=50..1000)
depth = Slider(11, range=1..15)
max_angle = Slider(27, range=5..90)
length_change_2 = Slider(0.6, range=-0.1..0.9)
max_angle_2 = Slider(48, range=5..90)
max_angle_3 = Slider(101, range=0..180)
starting_length_2 = Slider(240, range=50..1000)
depth_2 = Slider(8, range=1..15)
construct_point = ConstructPoint(XCoordinate=0, YCoordinate=range, ZCoordinate=Slider(0, range=0..20000))
construct_point_2 = ConstructPoint(XCoordinate=0, YCoordinate=0, ZCoordinate=0)
cull_duplicates = CullDuplicates(Tolerance=0.1, CullMode=3)  # -> Points, Indices, Valence
ghpython_script = GhPythonScript(
    anchorp=construct_point,
    depth=depth,
    angle=max_angle,
    length=starting_length,
    lvariation=length_change,
    aran=angle_randomness,
    lran=length_randomness)  # -> treelin, treept; inputs anchorp: Point3d
# ---------- ghpython_script: Python ----------
#importing grasshopper python modules
import rhinoscriptsyntax as rs
import Rhino.Geometry as rg

#importing generic modules
from math import cos
from math import sin
from math import radians
import random

#Inputs
#anchorp - point3D, anchor point
#depth - integer, recursion cnt
#angle - float, split base angle
#length - float, first branch length
#lvariation - float, length change with each branch
#aran - float, % of randomness in relation to base angle
#lran - float, % of randomness in relation to base length

#getting starting point from anchorpoint
x1 = anchorp.X
y1 = anchorp.Y
z1 = anchorp.Z

#setting base variables
x2 = x1
y2 = y1
z2 = z1

#base angle
anglerec = 0

#list of lines that form the tree, this is the output variable 
treelin = []


#recursive function
def fractal(depth , x2, y2, z2, length, anglerec, angle, lvariation, aran, lran):
    
    #test if depth>0
    if depth:
        
        #defining random angle variation and length variation
        arn = random.uniform(-angle/100*aran, angle/100*aran)
        lrn = random.uniform(-length/100*lran, length/100*lran)
        
        #defining points
        x1 = x2
        y1 = y2
        z1 = z2 
        z2 = z1 + (length+lrn)*cos(radians(anglerec))
        y2 = y1 + (length+lrn)*sin(radians(anglerec))
        
        #changing branch length dependant on branch depth
        length = length*lvariation
        
        #building points
        stpoint = [x1, y1, z1]
        endpoint = [x2, y2, z2]
        
        #building line between points
        treelin.append(rs.AddLine(stpoint, endpoint))
        
        #calling function with different angle parameter for branch splitting
        fractal(depth - 1 , x2, y2, z2, length, (anglerec+angle+arn), angle, lvariation, aran, lran)
        fractal(depth - 1 , x2, y2, z2, length, (anglerec-angle+arn), angle, lvariation, aran, lran)
        
#first recursive function call
fractal(depth, x2, y2, z2, length, anglerec, angle, lvariation, aran, lran)
# ---------- end ghpython_script ----------
ghpython_script_2 = GhPythonScript(
    anchorp=construct_point_2,
    depth=depth_2,
    angle=max_angle_2,
    angleh=max_angle_3,
    length=starting_length_2,
    lvariation=length_change_2,
    aran=angle_randomness_2,
    lran=length_randomness_2)  # -> treelin, treept, ahr; inputs anchorp: Point3d
# ---------- ghpython_script_2: Python ----------
#importing grasshopper python modules
import rhinoscriptsyntax as rs
import Rhino.Geometry as rg

#importing generic modules
from math import cos
from math import sin
from math import radians
import random

#Inputs
#anchorp - point3D, anchor point
#depth - integer, recursion cnt
#angle - float, split base angle
#length - float, first branch length
#lvariation - float, length change with each branch
#aran - float, % of randomness in relation to base angle
#lran - float, % of randomness in relation to base length

#getting starting point from anchorpoint
x1 = anchorp.X
y1 = anchorp.Y
z1 = anchorp.Z

#setting base variables
x2 = x1
y2 = y1
z2 = z1

#base angle
anglerec = 0
anglerech = 0

#list of lines that form the tree, this is the output variable 
treelin = []


#recursive function
def fractal(depth , x2, y2, z2, length, anglerec, angle, lvariation, aran, lran, anglerech, angleh):
    
    #test if depth>0
    if depth:
        
        #defining random angle variation and length variation
        arn = random.uniform(-angle/100*aran, angle/100*aran)
        lrn = random.uniform(-length/100*lran, length/100*lran)
        
        #defining horizontal rotation angles
        ahor = random.sample(range(0,360), 4)
        #removing numbers within tolerance
        ahr = rs.CullDuplicateNumbers(ahor, angleh)
        #adding random circle rot offset
        hrot = random.uniform(-180, 180)
        
        #defining points
        x1 = x2
        y1 = y2
        z1 = z2 
        x2 = x1 - (length+lrn)*sin(radians(anglerec))*sin(radians(anglerech))
        y2 = y1 + (length+lrn)*sin(radians(anglerec))*cos(radians(anglerech))
        z2 = z1 + (length+lrn)*cos(radians(anglerec))
        
        #changing branch length dependant on branch depth
        length = length*lvariation
        
        #building points
        stpoint = [x1, y1, z1]
        endpoint = [x2, y2, z2]
        
        #building line between points
        treelin.append(rs.AddLine(stpoint, endpoint))
        
        #calling function with different angle parameter for branch splitting
        #calling as many branches as spread within tolerance
        try:
            t = ahr[0]
            fractal(depth - 1 , x2, y2, z2, length, (anglerec+angle+arn), angle, lvariation, aran, lran, ahr[0]+hrot, angleh)
        except:
            pass
        try:
            t = ahr[1]
            fractal(depth - 1 , x2, y2, z2, length, (anglerec-angle+arn), angle, lvariation, aran, lran, ahr[1]+hrot, angleh)
        except:
            pass
        try:
            t = ahr[2]
            fractal(depth - 1 , x2, y2, z2, length, (anglerec+angle+arn), angle, lvariation, aran, lran, ahr[2]+hrot, angleh)
        except:
            pass
        try:
            t = ahr[3]
            fractal(depth - 1 , x2, y2, z2, length, (anglerec-angle+arn), angle, lvariation, aran, lran, ahr[3]+hrot, angleh)
        except:
            pass
        
#first recursive function call
fractal(depth, x2, y2, z2, length, anglerec, angle, lvariation, aran, lran, anglerech, angleh)
# ---------- end ghpython_script_2 ----------
panel = Panel(ghpython_script_2.ahr)
